# Grasshopper definition algorithmic_circular_dome.gh (Grasshopper 1.0.7)
# plug-ins: Kangaroo2 Components, karambaGH, Reader, SelectablePreview, Sift, Telepathy, MetaHopper, LunchBox, MOO, GhPolyhedra, Pufferfish, Fologram For Grasshopper Utilities, Hops

# ----
# Notes
# =====
# 
# 
# - Use meters for units, for simpler Karamba integration
# TODO
# ====
# 
# - Add spacing for connectors
# - Change strategy for rip cuts
# - Change to 7/12 vertical division
# GH File Info
docinfo = DocumentInfo(AutoUpdate=False, Recursive=False)  # -> DocumentName, DocumentFilePath, Components, Params, _3rdPartyAssemblies
split = TextSplit(Text=docinfo._3rdPartyAssemblies, Separators=",")
item = ListItem(List=split, Index=0, Wrap=True)  # -> flatten(Item)
detected = Panel(item)
python = PythonScript()  # -> rhino_doc_dir
# ---------- python: Python ----------
import scriptcontext as sc
from os import path

rhino_doc_dir = path.abspath(path.dirname(sc.doc.Path))
# ---------- end python ----------
used = Panel("""GhPolyhedra
karambaGH
Reader
SelectablePreview
Sift
Telepathy""")
txt_gh_file_path = RemoteSender(python)

# ----
# Controls
diplay_spacing_between_elements = Slider(1, range=0..2)
number_of_domes = Slider(1, range=1..3)
sample_size_pick_one_every_n = Slider(2, range=1..5)
gap_between_split_elements = Slider(0.3, range=0..1)
num_inventory_display_x_spacing = RemoteSender(diplay_spacing_between_elements)
num_inventory_display_y_spacing = RemoteSender(gap_between_split_elements)
int_inventory_sampling = RemoteSender(sample_size_pick_one_every_n)
num_graph_dot_size = RemoteSender(Slider(0.5, range=0..1))
int_dome_count = RemoteSender(number_of_domes)

wire_type = Slider(2, range=0..2)
clean_wire = Button()
wirecleaner = WireCleaner(on=clean_wire, wire_type=wire_type)  # -> out, a
# ---------- wirecleaner: Python ----------
from Grasshopper.Kernel import GH_ParamWireDisplay
from Grasshopper.Kernel import GH_RuntimeMessageLevel 

# A dictionary of wire types 
wire_display = {'0':GH_ParamWireDisplay.default, 
                '1':GH_ParamWireDisplay.faint,
                '2':GH_ParamWireDisplay.hidden}

# Get selected components and change the wire display
if on:
    doc = ghenv.Component.OnPingDocument()
    sel_objs = doc.SelectedObjects()
    if not len(sel_objs):
        ghenv.Component.AddRuntimeMessage(GH_RuntimeMessageLevel.Warning, 'Nothing was selected')
    for sel_obj  in sel_objs:
        if hasattr(sel_obj, 'Params'):
            for p in sel_obj.Params.Input:
                if hasattr(p, 'WireDisplay'):
                    p.WireDisplay = wire_display[wire_type]
        else:
            if hasattr(sel_obj, 'WireDisplay'):
                sel_obj.WireDisplay = wire_display[wire_type]
# ---------- end wirecleaner ----------

data_source = ValueList({"Geometry": 0, "CSV": 1}, selected="CSV")
num_connector_diameter = Number("0.11")
num_connector_diameter_2 = RemoteSender(num_connector_diameter)
int_data_source = RemoteSender(data_source)

# ---- group: Synthetic Quality Values
# Load from Model
panel = Panel("""Grade of Wood

Low=1
Medium=2
High=3""")
# Inventory
merge = Merge(
    Data1="3",
    Data2="3",
    Data3="3",
    Data4="2",
    Data5="2",
    Data6="3",
    Data7="3",
    Data8="3",
    Data9="2",
    Data10="1",
    Data11="1",
    Data12="2",
    Data13="1",
    Data14="3")

# ----
use_inventory_subsets = BooleanToggle(False)
series = Series(Start=0, Step=1, Count=Slider(10, range=0..10))  # -> graft(Series)

# ----
# Load Inventory Building
brep_internalized_geometry = Brep(Tree({0}: [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], {1}: [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], {2}: [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], {3}: [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], {4}: [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], {5}: [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]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))
# Load from CSV
tstat = TreeStatistics(Tree=brep_internalized_geometry)  # -> Paths, Length, Count
path = ConstructPath(Indices=series)  # -> flatten(Branch)
series_2 = Series(Start=0, Step=1, Count=tstat.Count)
gradient = Gradient(
    LowerLimit="0",
    UpperLimit=tstat.Count,
    Parameter=series_2,
    stops=[0.0441: RGB(255, 228, 196), 0.0598: RGB(255, 224, 192), 0.178: RGB(210, 180, 140), 0.31: RGB(80, 55, 25), 0.408: RGB(128, 64, 0), 0.517: RGB(160, 82, 45), 0.599: RGB(159, 65, 29), 0.737: RGB(184, 134, 11), 0.961: RGB(174, 166, 129)])
split_2 = SplitTree(Data=brep_internalized_geometry, Masks=flatten(path))  # -> Positive, Negative
int = Integer(simplify(graft(merge)))
split_3 = SplitTree(Data=int, Masks=flatten(path))  # -> Positive, Negative
filter = StreamFilter(Gate=use_inventory_subsets, Stream0=brep_internalized_geometry, Stream1=split_2.Positive)
col = Colour(simplify(graft(gradient)))
filter_2 = StreamFilter(Gate=use_inventory_subsets, Stream0=int, Stream1=split_3.Positive)
data = Data(filter)
split_4 = SplitTree(Data=col, Masks=flatten(path))  # -> Positive, Negative
long = LongestList(ListA=filter_2, ListB=data, PaddingMode=2)  # -> ListA, ListB
filter_3 = StreamFilter(Gate=use_inventory_subsets, Stream0=col, Stream1=split_4.Positive)
long_2 = LongestList(ListA=filter_3, ListB=data, PaddingMode=2)  # -> ListA, ListB
brep_model_geometry = Brep(data)
int_2 = Integer(flatten(long.ListA))
col_2 = Colour(long_2.ListA)
col_3 = Colour(filter_3)
preview = CustomPreview(Geometry=brep_model_geometry, Material=col_3)

standard_dimension = Panel("4")
kerf_width = Panel("0.3")
X = UnitX(Factor="120")
int_data_source_2 = RemoteReceiver(int_data_source)

# ----
# Redefine Geometry From Breps to Oriented Boxes
brep_model_geometry_2 = Brep(brep_model_geometry)
graft = GraftTree(Tree=brep_model_geometry_2, IncludeEmptyLists=True, IncludeNullItems=True)
debrep = DeconstructBrep(Brep=graft)  # -> Faces, Edges, Vertices
evalsrf = EvaluateSurface(Surface=reparameterize(debrep.Faces), Point="0.5,0.5")  # -> Point, Normal, UDirection, VDirection, Frame
Z = UnitZ(Factor=1)
dprod = DotProduct(VectorA=Z, VectorB=evalsrf.Normal, Unitize=False)
equals = Equality(FirstNumber=dprod, SecondNumber="0")  # -> Equality, Inequality
cull = CullPattern(List=debrep.Faces, CullPattern=equals.Inequality)
planar = IsPlanar(Surface=cull, Interior=True)  # -> Planar, Plane
area = Area(Geometry=cull)  # -> Area, Centroid
sort = SortList(Keys=area.Area, ValuesA=planar.Plane)  # -> Keys, ValuesA
item_2 = ListItem(List=planar.Plane, Index=0, Wrap=True)
item_3 = ListItem(List=sort.ValuesA, Index=0, Wrap=True)  # -> Item1, Item
bbox = BoundingBox(Content=graft, Plane=item_2)  # -> Box, Box_2
bbox_2 = BoundingBox(Content=graft, Plane=item_3.Item1)  # -> Box, Box_2
volume = Volume(Geometry=bbox.Box)  # -> Volume, Centroid
volume_2 = Volume(Geometry=bbox_2.Box)  # -> Volume, Centroid
smaller = SmallerThan(FirstNumber=volume.Volume, SecondNumber=volume_2.Volume)  # -> SmallerThan, OrEqualTo
p_n_c = PickNChoose(Pattern=smaller.SmallerThan, Stream0=bbox_2.Box, Stream1=bbox.Box)
box = Box(p_n_c)

# ----
# Sort Other Dimensions by Long Dimension
debox = DeconstructBox(Box=box)  # -> Plane, simplify(X), simplify(Y), simplify(Z)
merge_2 = Merge(Data1=debox.X, Data2=debox.Y, Data3=debox.Z)
sort_2 = SortList(Keys=merge_2)  # -> Keys, ValuesA
item_4 = ListItem(List=sort_2.Keys, Index=0, Wrap=True)  # -> Item, Item1, Item2
pshift = ShiftPaths(Data=item_4.Item, Offset=-1)
pshift_2 = ShiftPaths(Data=item_4.Item1, Offset=-1)
pshift_3 = ShiftPaths(Data=item_4.Item2, Offset=-1)
sort_3 = SortList(Keys=pshift_3, ValuesA=pshift)  # -> Keys, ValuesA
sort_4 = SortList(Keys=pshift_3, ValuesA=pshift_2)  # -> Keys, ValuesA
num_sorted_x = Number(sort_3.ValuesA)
num_sorted_z = Number(sort_4.Keys)
num_sorted_y = Number(sort_4.ValuesA)

# ----
# Rip Boards to Square Cross Section
int_inventory_sampling_2 = RemoteReceiver(int_inventory_sampling)
cluster = Cluster_2(list=num_sorted_x, size=int_inventory_sampling_2)
cluster_2 = Cluster_2(list=num_sorted_y, size=int_inventory_sampling_2)
cluster_3 = Cluster_2(list=num_sorted_z, size=int_inventory_sampling_2)
box_2 = DomainBox(Base=PlaneXY(0, 0, 0), X=cluster, Y=cluster, Z=cluster_3)  # -> simplify(graft(Box))
division = Division(A=cluster_2, B=cluster)  # -> simplify(graft(Result))
round = Round(Number=division)  # -> Nearest, Floor, Ceiling
box_elements_at_origin = Box(box_2)
int_split_count = Integer(round.Floor)

num_inventory_display_x_spacing_2 = RemoteReceiver(num_inventory_display_x_spacing)

# ----
# Display Elements after Ripping
tstat_2 = TreeStatistics(Tree=box_elements_at_origin)  # -> Paths, Length, Count
series_3 = Series(Start=0, Step=num_inventory_display_x_spacing_2, Count=tstat_2.Count)
X_2 = UnitX(Factor=graft(series_3))  # -> simplify(UnitVector)
match = MatchTree(Tree=X_2, Guide=box_elements_at_origin)
num_inventory_display_y_spacing_2 = RemoteReceiver(num_inventory_display_y_spacing)
move = Move(Geometry=box_elements_at_origin, Motion=match)  # -> Geometry, Transform
Y = UnitY(Factor=num_inventory_display_y_spacing_2)
arrlinear = LinearArray(Geometry=move.Geometry, Direction=Y, Count=int_split_count)  # -> Geometry, Transform

int_3 = Integer(series_3)
lng = ListLength(List=int_3)
multiplication = Multiplication(A=lng, B=Slider(0.333, range=0..1))
int_4 = Integer(multiplication)
item_5 = ListItem(List=int_3, Index=int_4, Wrap=True)
num_inventory_label_x_coordinate = RemoteSender(item_5)

int_data_source_3 = RemoteReceiver(int_data_source)
pt = Point(Point(0, 0, 0))
pt_2 = Point(Point(1, 0, 0))
ln = Line(StartPoint=pt, EndPoint=pt_2)

# ---- group: Scaling parameterized curve
# Design
number_slider = Slider(0.89, range=0..1)
number_slider_2 = Slider(0, range=0..1)
number_slider_3 = Slider(0.92, range=0..1)
number_slider_4 = Slider(0.8, range=0..1)

# ---- group: Subdivision parameterized curve
number_slider_5 = Slider(1, range=0..1)
number_slider_6 = Slider(0.95, range=0..1)
number_slider_7 = Slider(0.9, range=0..1)
number_slider_8 = Slider(0.69, range=0..1)

# ----
int_dome_count_2 = RemoteReceiver(int_dome_count)

# ---- group: Subdivision parameterized curve / Bounds of subdivision [integer]
dom = ConstructDomain(DomainStart="1", DomainEnd="2")

# ---- group: Scaling parameterized curve / Bounds of scale [m]
dom_2 = ConstructDomain(DomainStart="1", DomainEnd="3")

# ---- group: Scaling parameterized curve
merge_3 = Merge(Data1=number_slider, Data2=number_slider_3, Data3=number_slider_4, Data4=number_slider_2)
lng_2 = ListLength(List=merge_3)
subtraction = Subtraction(A=lng_2, B=1)
addition = Addition(A=int_dome_count_2, B=1)
divide = DivideCurve(Curve=ln, Count=subtraction, Kinks=False)  # -> Points, Tangents, Parameters
Z_2 = UnitZ(Factor=merge_3)
divide_2 = DivideCurve(Curve=ln, Count=addition, Kinks=False)  # -> Points, Tangents, Parameters
dom_3 = ConstructDomain(DomainStart="1", DomainEnd=int_dome_count_2)
move_2 = Move(Geometry=divide.Points, Motion=Z_2)  # -> Geometry, Transform
subset = SubList(List=divide_2.Points, Domain=dom_3, Wrap=True)  # -> List, Index
subtraction_2 = Subtraction(A=lng_2, B=1)
sort_pt = SortPoints(Points=move_2.Geometry)  # -> Points, Indices
Z_3 = UnitZ(Factor=1)
nurbs = NurbsCurve(Vertices=sort_pt.Points, Degree=subtraction_2, Periodic=False)  # -> Curve, Length, Domain
project = ProjectPoint(Point=subset.List, Direction=Z_3, Geometry=nurbs.Curve)  # -> Point, Index
pdecon = Deconstruct(Point=project.Point)  # -> XComponent, YComponent, ZComponent
remap = RemapNumbers(Value=pdecon.ZComponent, Source=Domain(0, 1), Target=dom_2)  # -> Mapped, Clipped

# ---- group: Subdivision parameterized curve
int_dome_count_3 = RemoteReceiver(int_dome_count)
merge_4 = Merge(Data1=number_slider_5, Data2=number_slider_6, Data3=number_slider_7, Data4=number_slider_8)
lng_3 = ListLength(List=merge_4)
addition_2 = Addition(A=int_dome_count_3, B=1)
subtraction_3 = Subtraction(A=lng_3, B=1)
divide_3 = DivideCurve(Curve=ln, Count=subtraction_3, Kinks=False)  # -> Points, Tangents, Parameters
Z_4 = UnitZ(Factor=merge_4)
divide_4 = DivideCurve(Curve=ln, Count=addition_2, Kinks=False)  # -> Points, Tangents, Parameters
dom_4 = ConstructDomain(DomainStart="1", DomainEnd=int_dome_count_3)
move_3 = Move(Geometry=divide_3.Points, Motion=Z_4)  # -> Geometry, Transform
subset_2 = SubList(List=divide_4.Points, Domain=dom_4, Wrap=True)  # -> List, Index
subtraction_4 = Subtraction(A=lng_3, B=1)
sort_pt_2 = SortPoints(Points=move_3.Geometry)  # -> Points, Indices
Z_5 = UnitZ(Factor=1)
nurbs_2 = NurbsCurve(Vertices=sort_pt_2.Points, Degree=subtraction_4, Periodic=False)  # -> Curve, Length, Domain
project_2 = ProjectPoint(Point=subset_2.List, Direction=Z_5, Geometry=nurbs_2.Curve)  # -> Point, Index
pdecon_2 = Deconstruct(Point=project_2.Point)  # -> XComponent, YComponent, ZComponent
remap_2 = RemapNumbers(Value=pdecon_2.ZComponent, Source=Domain(0, 1), Target="0 to 3")  # -> Mapped, Clipped
round_2 = Round(Number=remap_2.Mapped)  # -> Nearest, Floor, Ceiling

# ---- group: Subdivision parameterized curve / Subdivision values
num = Number(round_2.Floor)

# ----
panel_2 = Panel("""2.5
2.5
2.5""")
panel_3 = Panel("""0
1
2""")

# ---- group: Scaling parameterized curve / Scale values
num_2 = Number(remap.Mapped)

# ---- group: Array domes in a line
spacing_between_domes = Slider(2, range=0..10)
multiplication_2 = Multiplication(A=num_2, B=spacing_between_domes)
gap = Panel("1")
addition_3 = Addition(A=multiplication_2, B=gap)
ma = MassAddition(Input=addition_3)  # -> Result, PartialResults
item_6 = ListItem(List=addition_3, Index=0, Wrap=True)
subtraction_5 = Subtraction(A=ma.PartialResults, B=item_6)
X_3 = UnitX(Factor=subtraction_5)

# ----
int_division = Integer("1")
num_scale = Number(num_2)
polyhedra_names = PolyhedraNames(Category="Geodesic Icosahedra")
panel_4 = Panel("""1
3
6""")
item_7 = ListItem(List=polyhedra_names, Index=panel_4, Wrap=True)
item_8 = ListItem(List=item_7, Index=int_division, Wrap=True)
polyhedron = Polyhedron(Name=item_8, Plane=PlaneXY(0, 0, 0), Scale=num_scale)  # -> Curves, Meshes, Solid
mjoin = MeshJoin(Meshes=polyhedron.Meshes)  # -> flatten(Mesh)
rebmsh = RebuildMesh(
    Mesh=mjoin,
    RebuildNormals=False,
    CullUnused=False,
    UnifyNormals=False,
    FlipNormals=False,
    IdenticalCombine="1",
    WeldVertices=0)

move_4 = Move(Geometry=rebmsh, Motion=X_3)  # -> Geometry, Transform
mesh = Mesh(simplify(graft(move_4.Geometry)))

# ---- group: Find a 5-valence Point
demesh = DeconstructMesh(Mesh=mesh)  # -> Vertices, Faces, Colours, Normals
deface = DeconstructFace(Face=demesh.Faces)  # -> CornerA, CornerB, CornerC, CornerD
merge_5 = Merge(Data1=deface.CornerA, Data2=deface.CornerB, Data3=deface.CornerC)
cset = CreateSet(List=merge_5)  # -> Set, Map
mindex = MemberIndex(Set=merge_5, Member=cset.Set)  # -> Index, Count
equals_2 = Equality(FirstNumber=mindex.Count, SecondNumber="5")  # -> Equality, Inequality
dispatch = Dispatch(List=cset.Set, DispatchPattern=equals_2.Equality)  # -> ListA, ListB
item_9 = ListItem(List=dispatch.ListA, Index=0, Wrap=True)  # -> simplify(Item)

# ---- group: orient dome using a 5-valence vertex and normal
int_vertex_id = Integer(item_9)
mesh_2 = Mesh(mesh)
vn = VertexNeighbours(Mesh=mesh_2, VertexNumber=int_vertex_id)  # -> Vertex, simplify(Neighbours), Normal
volume_3 = Volume(Geometry=mesh_2)  # -> Volume, Centroid
pl = PlaneNormal(Origin=vn.Vertex, ZAxis=vn.Normal)
xy = XYPlane(Origin=volume_3.Centroid)
orient = Orient(Geometry=mesh_2, Source=pl, Target=xy)  # -> Geometry, Transform
volume_4 = Volume(Geometry=orient.Geometry)  # -> Volume, Centroid
vec2pt = Vector2Pt(PointA=volume_4.Centroid, PointB=volume_3.Centroid, Unitize=False)  # -> Vector, Length
move_5 = Move(Geometry=orient.Geometry, Motion=vec2pt.Vector)  # -> Geometry, Transform

# ----
num_scale_2 = Number(simplify(graft(num_2)))
num_connector_diameter_3 = RemoteReceiver(num_connector_diameter_2)
txt_gh_file_path_2 = RemoteReceiver(txt_gh_file_path)

# ---- group: penalty
num_3 = Number("1e7")

# ---- group: Import remote python modules
restart_python = BooleanToggle(True)
txt_gh_file_path_3 = RemoteReceiver(txt_gh_file_path)
list = ValueList({"CRITICAL", "ERROR", "WARNING", "INFO", "DEBUG", "NOTSET"}, selected="DEBUG")
panel_5 = Panel("""numpy
julia""")
ghpythonremote = GHPythonRemote(location="conda://py27", run=restart_python, modules=panel_5, log_level=list, working_dir=txt_gh_file_path_3)  # -> out, linked_modules, rpy; inputs run: Boolean, modules: list
# ---------- ghpythonremote: Python ----------
import sys
import scriptcontext
import logging
import inspect
import ghpythonremote
from ghpythonremote.connectors import GrasshopperToPythonRemote
from os import path
from time import sleep

local_log_level = getattr(logging, log_level, logging.WARNING)
logger = logging.getLogger('ghpythonremote')
logger.setLevel(local_log_level)
ch = logging.StreamHandler()
ch.setLevel(local_log_level)
formatter = logging.Formatter('%(levelname)s: %(name)s:\n%(message)s')
ch.setFormatter(formatter)
logger.handlers = []
logger.addHandler(ch)
logger = logging.getLogger('ghpythonremote.GH_to_python')

ROOT = path.abspath(path.dirname(inspect.getfile(ghpythonremote)))
rpyc_server_py = path.join(ROOT, 'pythonservice.py')

# Set connection to CLOSED if this is the first run
# and initialize set of linked modules
try:
    remote_python_status
except NameError:
    remote_python_status = 'CLOSED'
    lkd_modules = set()

# Wait for connection to connect or terminate
timer = 0
while remote_python_status == 'CONNECTING' or remote_python_status == 'CLOSING':
    sleep(1)
    timer += 1
    if timer == 10:
        try:
            gh2py_manager.__exit__(*sys.exc_info())
        except Exception:
            pass
        remote_python_status = 'CLOSED'
        lkd_modules = set()
        raise RuntimeError("Connection left in an inconsistent state and not returning. Reset everything.")

if run:
    if not remote_python_status == 'OPEN':
        remote_python_status = 'CONNECTING'
        gh2py_manager = GrasshopperToPythonRemote(rpyc_server_py, location=location, timeout=10,
                                                  port=None, log_level=log_level, working_dir=working_dir)
        gh2py = gh2py_manager.__enter__()
        remote_python_status = 'OPEN'

    # Stuff that we can reach
    rpymod = gh2py.py_remote_modules  # A getter function for a named python module
    rpy = gh2py.connection  # Represents the remote instance root object
    scriptcontext.sticky['rpy'] = rpy
    # Add modules
    for mod in modules:
        try:
            scriptcontext.sticky[mod] = rpymod(mod)
            lkd_modules.add(mod)
        except ImportError:
            gh2py_manager.__exit__(*sys.exc_info())
            raise

elif not remote_python_status == 'CLOSED':
    remote_python_status = 'CLOSING'
    # Remove linked modules
    for mod in lkd_modules:
        del scriptcontext.sticky[mod]
    del scriptcontext.sticky['rpy']
    gh2py_manager.__exit__(*sys.exc_info())
    lkd_modules = set()
    remote_python_status = 'CLOSED'

# Change variable name because ghpython resets outputs to None before each run
linked_modules = lkd_modules

logger.info('GH to python connection is {}'.format(remote_python_status))
# ---------- end ghpythonremote ----------
python_2 = PythonScript(module_names=ghpythonremote.linked_modules)  # -> import_statements; inputs module_names: list
# ---------- python_2: Python ----------
import_statements = ["import scriptcontext as sc"]
for module_name in module_names:
    import_statements.append("{0} = sc.sticky['{0}']".format(module_name))

if len(module_names) == 0:
    import_statements = []
# ---------- end python_2 ----------
panel_6 = Panel(ghpythonremote.out)
panel_7 = Panel(python_2)

# ----
txt_gh_file_path_4 = RemoteReceiver(txt_gh_file_path)
list_2 = ValueList({"Hungarian - C#": 0, "Hungarian - Julia": 1, "ILP": 2}, selected="ILP")

equals_3 = Equality()  # -> Equality, Inequality
cset_2 = CreateSet(List=equals_3.Equality)  # -> Set, Map
panel_8 = Panel(cset_2.Set)

# ---- group: toggle matching line viz here!
viz_matching_line = BooleanToggle(True)

# ----
rgb = ColourRGB(Alpha="20", Red=0, Green=0, Blue="255")

path_2 = FilePath("C:\Users\mattj\Documents\eth\algorithmic_circular_design\geneva_inventory_wood_beams.csv")
file = ReadFile(File=path_2, PerLineParse=True)
csv = ReadCSV(CSVString=file, Delimiter=",")  # -> Headers, Values
bang = ExplodeTree(Data=csv.Values)  # -> Branch0, Branch1, Branch2, Branch3
panel_9 = Panel(csv.Headers)
cm_m = Panel("0.01")
num_inventory_display_x_spacing_3 = RemoteReceiver(num_inventory_display_x_spacing)
num_inventory_display_y_spacing_3 = RemoteReceiver(num_inventory_display_y_spacing)
Y_2 = UnitY(Factor=num_inventory_display_y_spacing_3)

num_4 = Number(bang.Branch2)
num_5 = Number(bang.Branch3)
expression = Expression(
    s=standard_dimension,
    k=kerf_width,
    x=num_4,
    y=num_5,
    Expression="(floor((x - s) / (s+k)) + 1) * (floor((y - s) / (s+k))+ 1)")
expression_2 = Expression(n=num_4, k=kerf_width, Expression="(n - k) / 2")
expression_3 = Expression(n=num_5, k=kerf_width, Expression="(n - k) / 2")
panel_10 = Panel(expression)
multiplication_3 = Multiplication(A=bang.Branch0, B="4")
csv_2 = CreateCSV(ValueTree=panel_10, Delimiter=",")

box_3 = DomainBox(Base=PlaneXY(0, 0, 0), X=expression_2, Y=expression_3, Z=bang.Branch1)
scale = Scale(Geometry=box_3, Center=Point(0, 0, 0), Factor=cm_m)  # -> Geometry, Transform
lng_4 = ListLength(List=scale.Geometry)
series_4 = Series(Start=0, Step=num_inventory_display_x_spacing_3, Count=lng_4)
X_4 = UnitX(Factor=series_4)
range = Range(Domain=Domain(0, 1), Steps=lng_4)
subtraction_6 = Subtraction(A=lng_4, B="1")
move_6 = Move(Geometry=scale.Geometry, Motion=X_4)  # -> Geometry, Transform
subset_3 = SubList(List=range, Domain=subtraction_6, Wrap=True)  # -> List, Index
hsv = ColourHSV(Alpha=1, Hue=expr("x * 0.5 + 0.5", subset_3.List), Saturation=1, Value=1)
arrlinear_2 = LinearArray(Geometry=move_6.Geometry, Direction=Y_2, Count=multiplication_3)  # -> simplify(Geometry), Transform

move_7 = Move(Geometry=arrlinear_2.Geometry, Motion=X)  # -> Geometry, Transform

long_3 = LongestList(ListA=move_7.Geometry, ListB=graft(hsv), PaddingMode=2)  # -> ListA, simplify(ListB)

filter_4 = StreamFilter(Gate=int_data_source_2, Stream0=col_2, Stream1=long_3.ListB)
col_inventory_colors = RemoteSender(filter_4)
filter_5 = StreamFilter(Gate=int_data_source_3, Stream0=arrlinear.Geometry, Stream1=move_7.Geometry)
box_inventory = RemoteSender(filter_5)

box_inventory_2 = RemoteReceiver(box_inventory)
debox_2 = DeconstructBox(Box=box_inventory_2)  # -> Plane, X, Y, Z
num_6 = Number(flatten(debox_2.X))
num_7 = Number(flatten(debox_2.Y))
num_8 = Number(flatten(debox_2.Z))
num_inventory_cross_section_x = RemoteSender(num_6)
num_inventory_cross_section_y = RemoteSender(num_7)
num_inventory_length = RemoteSender(num_8)

# ----
# inventory cross section x
# inventory cross section y
num_inventory_cross_section_x_2 = RemoteReceiver(num_inventory_cross_section_x)
num_inventory_cross_section_y_2 = RemoteReceiver(num_inventory_cross_section_y)
num_9 = Number(num_inventory_cross_section_y_2)
num_10 = Number(num_inventory_cross_section_x_2)

num_inventory_length_2 = RemoteReceiver(num_inventory_length)
lng_5 = ListLength(List=num_inventory_length_2)
num_inventory_length_3 = RemoteReceiver(num_inventory_length)

col_inventory_colors_2 = RemoteReceiver(col_inventory_colors)
int_inventory_sampling_3 = RemoteReceiver(int_inventory_sampling)
col_4 = Colour(col_inventory_colors_2)
cluster_4 = Cluster_2(list=col_4, size=int_inventory_sampling_3)

item_10 = ListItem(List=col_inventory_colors_2, Index=0, Wrap=True)

# ----
# Inventory Display
number_slider_9 = Slider(0.9, range=0..1)
box_inventory_3 = RemoteReceiver(box_inventory)
material = CreateMaterial(Diffuse=item_10, Specular=RGB(255, 255, 255), Emission=RGB(0, 0, 0), Transparency=number_slider_9, Shine=0)
graft_2 = GraftTree(Tree=material, IncludeEmptyLists=True, IncludeNullItems=True)
brep = Brep(simplify(box_inventory_3))
preview_2 = CustomPreview(Geometry=brep, Material=material)

# ---- group: inventory color / inventory colors
col_5 = Colour(flatten(col_inventory_colors_2))

# ----
num_inventory_length_4 = RemoteReceiver(num_inventory_length)
graft_3 = GraftTree(Tree=col_5, IncludeEmptyLists=True, IncludeNullItems=True)  # -> simplify(Tree)

# ----
# Design Space Exploration
panel_11 = Panel("feasible_match-floor_data.csv")
rhino_doc_dir = RhinoDocDir()  # -> rhino_doc_dir; same code as python
txt = Text("feasible_MOO_match-coverage_data.csv")
concat = Concatenate(FragmentA=rhino_doc_dir, FragmentA_2="/data/", FragmentB=txt)
path_3 = FilePath("C:\Users\mattj\Documents\eth\algorithmic_circular_design\allSolutions-moo_out.csv")
reader = Reader(Filepath=path_3, Separator=",")
number_slider_10 = Slider(100, range=10..100)
num_graph_dot_size_2 = RemoteReceiver(num_graph_dot_size)
num_graph_dot_size_3 = RemoteReceiver(num_graph_dot_size)
addition_4 = Addition(A=number_slider_10, B="10")
addition_5 = Addition(A=number_slider_10, B="10")
number_slider_11 = Slider(17, range=0..100)
Y_3 = UnitY(Factor=addition_4)
X_5 = UnitX(Factor=addition_5)
txt_2 = Text(txt)
X_6 = UnitX(Factor=1)
pt_3 = Point("2.0,0,0")
number_slider_12 = Slider(1.5, range=0..10)
tmatch = MatchText(Text=txt_2, RegEx="floor", Case=True)
Y_4 = UnitY(Factor=1)
neg = Negative(Value=X_6)
pt_4 = Point("0,2.0,0")
filter_6 = StreamFilter(Gate=tmatch, Stream0="material coverage", Stream1="total floor area")
panel_12 = Panel(txt_2)
panel_13 = Panel(tmatch)

# ----
# get rid of column names
panel_14 = Panel("{0}")
split_5 = SplitTree(Data=reader, Masks=flatten(panel_14))  # -> Positive, Negative

# ---- group: origin
Y_5 = UnitY(Factor=Slider(10, range=10..30))

# ----
panel_15 = Panel(split_5.Positive)
split_6 = SplitList(List=split_5.Negative, Index="9")  # -> simplify(ListA), simplify(ListB)
item_11 = ListItem(List=split_6.ListB, Index=0, Wrap=True)  # -> Item, Item1
neg_2 = Negative(Value=item_11.Item1)
panel_16 = Panel(item_11.Item)
panel_17 = Panel(item_11.Item1)
cluster_5 = Cluster_3(number=item_11.Item, domain_end=number_slider_10)
cluster_6 = Cluster_3(number=neg_2, domain_end=number_slider_10)
pt_5 = ConstructPoint(XCoordinate=cluster_5, YCoordinate=cluster_6, ZCoordinate=0)
num_11 = Number(split_6.ListA)

# ----
# Geodesic Dome
num_inventory_label_x_coordinate_2 = RemoteReceiver(num_inventory_label_x_coordinate)
pt_6 = ConstructPoint(XCoordinate=num_inventory_label_x_coordinate_2, YCoordinate=Slider(25.44, range=0..100), ZCoordinate=0)
move_8 = Move(Geometry=move_5.Geometry, Motion=pt_6)  # -> Geometry, Transform
medges = MeshEdges(Mesh=move_8.Geometry)  # -> NakedEdges, InteriorEdges, NonManifoldEdges
faceb = FaceBoundaries(Mesh=move_8.Geometry)
merge_6 = Merge(Data1=medges.NakedEdges, Data2=medges.InteriorEdges, Data3=medges.NonManifoldEdges)  # -> simplify(Result)
end = EndPoints(Curve=merge_6)  # -> Start, End
pdecon_3 = Deconstruct(Point=end.Start)  # -> XComponent, YComponent, ZComponent
pdecon_4 = Deconstruct(Point=end.End)  # -> XComponent, YComponent, ZComponent
expression_4 = Expression(z1=pdecon_3.ZComponent, z2=pdecon_4.ZComponent, n="-0.3", r=num_scale_2, Expression="(z1 < (r * n)) or (z2 < (r * n))")
dispatch_2 = Dispatch(List=merge_6, DispatchPattern=expression_4)  # -> ListA, ListB
X_7 = UnitX(Factor=Slider(10, range=0..10))
mesh_design_mesh = RemoteSender(move_8.Geometry)

# ---- group: origin (continued)
pt_7 = Point(pt_6)
move_9 = Move(Geometry=pt_7, Motion=Y_5)  # -> Geometry, Transform
pt_graph_origin = RemoteSender(move_9.Geometry)

# ----
pt_graph_origin_2 = RemoteReceiver(pt_graph_origin)
long_4 = LongestList(ListA=pt_graph_origin_2, ListB=pt_5, PaddingMode=2)  # -> ListA, ListB
match_2 = MatchTree(Tree=long_4.ListA, Guide=pt_5)
addition_6 = Addition(A=match_2, B=pt_5)
dots = DotDisplay(Point=addition_6, Colour=ColourSwatch(SwatchColor=RGB(15, 131, 255)), Size=num_graph_dot_size_2)
selpv = SelectablePreview(Geometry=addition_6, lock=False, maintain=False, order=False)  # -> Geometry, Path, Index
pt_graph_origin_3 = RemoteReceiver(pt_graph_origin)
item_12 = ListItem(List=selpv.Path, Index=0, Wrap=True)  # -> Item1, Item
branch = TreeBranch(Tree=split_6.ListB, Path=item_12.Item1, MaintainPaths=True)
branch_2 = TreeBranch(Tree=num_11, Path=item_12.Item1, MaintainPaths=True)
dpath = DeconstructPath(Branch=item_12.Item1)
panel_18 = Panel(item_12.Item1)
subtraction_7 = Subtraction(A=dpath, B=1)
panel_19 = Panel(branch)
move_10 = Move(Geometry=pt_graph_origin_3, Motion=X_5)  # -> Geometry, Transform
move_11 = Move(Geometry=pt_graph_origin_3, Motion=Y_3)  # -> Geometry, Transform
dots_2 = DotDisplay(Point=pt_graph_origin_3, Colour=ColourSwatch(SwatchColor=RGB(0, 0, 0)), Size=num_graph_dot_size_3)
sift = Sift(
    Variables=[number_slider, number_slider_3, number_slider_4, number_slider_2, number_slider_5, number_slider_6, number_slider_7, number_slider_8, number_of_domes],
    DesignMap=num_11,
    Index=subtraction_7)
ln_2 = Line(StartPoint=pt_graph_origin_3, EndPoint=move_11.Geometry)
ln_3 = Line(StartPoint=pt_graph_origin_3, EndPoint=move_10.Geometry)
panel_20 = Panel(sift)
midpt = CurveMiddle(Curve=ln_2)
midpt_2 = CurveMiddle(Curve=ln_3)
panel_21 = Panel(branch_2)
subtraction_8 = Subtraction(A=midpt, B=pt_3)
subtraction_9 = Subtraction(A=midpt_2, B=pt_4)
pl_2 = ConstructPlane(Origin=subtraction_8, XAxis=Y_4, YAxis=neg)
tag = TextTag3D(Location=pl_2, Text=filter_6, Size=number_slider_12, Justification=7)
tag_2 = TextTag3D(Location=subtraction_9, Text="matching score", Size=number_slider_12, Justification=7)

panel_22 = Panel(addition_6)
panel_23 = Panel(selpv.Path)

# ---- group: floor area
bbox_3 = BoundingBox(Content=faceb, Plane=PlaneXY(0, 0, 0), UnionBox=True)  # -> Box, Box_2
debox_3 = DeconstructBox(Box=bbox_3.Box)  # -> Plane, X, Y, Z
cluster_7 = Cluster(domain=debox_3.X)
cluster_8 = Cluster(domain=debox_3.Y)
division_2 = Division(A=cluster_7, B=2)
division_3 = Division(A=cluster_8, B=2)
min = Minimum(A=division_2, B=division_3)
pow = Power(A=min, B="2")
pi = Pi(Factor=pow)  # -> flatten(Output)
num_dome_floor_area = RemoteSender(pi)

# ----
bbox_4 = BoundingBox(Content=dispatch_2.ListB, Plane=PlaneXY(0, 0, 0), UnionBox=True)  # -> Box, Box_2
box_4 = EvaluateBox(Box=bbox_4.Box_2, UParameter="0.5", VParameter="0.5", WParameter="0")  # -> Plane, Point, Include
pdecon_5 = Deconstruct(Point=box_4.Point)  # -> XComponent, YComponent, ZComponent
neg_3 = Negative(Value=pdecon_5.ZComponent)
Z_6 = UnitZ(Factor=neg_3)
move_12 = Move(Geometry=dispatch_2.ListB, Motion=Z_6)  # -> Geometry, Transform

crv = Curve(move_12.Geometry)
len = Length(Curve=crv)
cset_3 = CreateSet(List=len)  # -> Set, Map
lng_6 = ListLength(List=cset_3.Set)
division_4 = Division(A=cset_3.Map, B=lng_6)
hsv_2 = ColourHSV(Alpha=1, Hue=division_4, Saturation=1, Value=1)
preview_3 = CustomPreview(Geometry=crv, Material=hsv_2)

col_6 = Colour(hsv_2)

arrlinear_3 = LinearArray(Geometry=move_12.Geometry, Direction=X_7, Count=Slider(1, range=0..10))  # -> flatten(Geometry), Transform
len_2 = Length(Curve=arrlinear_3.Geometry)
crv_design_curves = RemoteSender(arrlinear_3.Geometry)

subtraction_10 = Subtraction(A=len_2, B=num_connector_diameter_3)

num_design_length = RemoteSender(subtraction_10)

# ----
# Karamba FEA
mesh_design_mesh_2 = RemoteReceiver(mesh_design_mesh)
crv_design_curves_2 = RemoteReceiver(crv_design_curves)
mesh_3 = Mesh(mesh_design_mesh_2)
crv_2 = Curve(crv_design_curves_2)
end_2 = EndPoints(Curve=crv_2)  # -> Start, End
rdpoints = RemoveDuplicatePointsKaramba3D(Point=[end_2.Start, end_2.End], LimitDistance=0.005)  # -> OutPoint, Info, Indexes
pdecon_6 = Deconstruct(Point=rdpoints.OutPoint)  # -> XComponent, YComponent, ZComponent
sort_5 = SortList(Keys=pdecon_6.ZComponent)  # -> Keys, ValuesA
item_13 = ListItem(List=sort_5.Keys, Index=0, Wrap=True)
num_12 = Number("0.1")
expression_5 = Expression(zmin=item_13, z=pdecon_6.ZComponent, tol=num_12, Expression="if(abs(zmin-z)<tol,true,false)")
faceb_2 = FaceBoundaries(Mesh=mesh_3)
boundary = BoundarySurfaces(Edges=flatten(faceb_2))
cull_2 = CullPattern(List=rdpoints.OutPoint, CullPattern=expression_5)
panel_24 = Panel("5")
mesh_breps = MeshBrepsKaramba3D(
    Brep=boundary,
    MeshResolution=Slider(100, range=0..100),
    EdgeRefinementFactor=0.67,
    PointReduction=False,
    SmoothingStepSize=0,
    SmoothingIterations=5)  # -> Mesh, Info
Z_7 = UnitZ(Factor=Slider(4, range=1..5))  # -> expr("-x", UnitVector)
supp = SupportKaramba3D(PosInd=cull_2, menu=[buttons(on, on, on, off, off, off)])
cross_section = CrossSectionKaramba3D(
    FamilyNameOfCrossSection="DefaultCroSec",
    Material=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,
    Height_cm="4",
    UpperFlangeWidth_cm="4",
    LowerFlangeWidth_cm="4",
    mode="Trapezoid")
loads = LoadsKaramba3D(Vector=Z_7, Mesh=mesh_breps.Mesh, LCase=0, mode="MeshLoad -Const.", menu=[buttons(off, on, off), buttons(off, on)])
matselect = MaterialSelectionKaramba3D(menu=[dropdown(4), dropdown(1)])
linetobeam = LineToBeamKaramba3D(Line=crv_2, New=True, Remove=True, LimitDistance_m=0.005, Bending=Toggle(False))  # -> Element, Points, Info
assemble = AssembleModelKaramba3D(Elem=linetobeam.Element, Support=supp, Load=loads, CrossSection=cross_section, Material=matselect, LimitDistance_m=0.005)  # -> Model, Info, Mass_kg, CenterOfGravity
analyze = AnalyzeKaramba3D(Model=assemble.Model)  # -> CalculatedModel, MaximumDisplacement_cm, ResultingForceOfGravity_kN, ElasticEnergy_kNm
disassemble = DisassembleMaterialKaramba3D(Material=matselect)  # -> Material, TypeOfMaterial, FamilyNameOfMaterial, NameOfMaterial, ElemIdentifiers, Color, YoungsModulusKNCm2Dir12, InPlaneShearModulus_kN_cm2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
modelview = ModelViewKaramba3D(Model=analyze.CalculatedModel, ResultFactors=1, ResultCase=-1)  # -> Model, DeformedMesh, DeformedAxes, DeformedModel
beamview = BeamViewKaramba3D(Model=modelview.Model)  # -> Model, MeshesOfRenderedBeams, DeformedBeamAxes, LegendColors, LegendTags
b_forces = BeamForcesKaramba3D(AnalyzedModel=analyze.CalculatedModel, LCase=-1, MaximumDistanceBetweenResults_m=-1, NumberOfResultsPerBeamElement=2)  # -> AnalyzedModel, NormalForce_kN, ShearForceVz_kN, ShearForceVy_kN, BendingMomentMt_kNm, BendingMomentMy_kNm, BendingMomentMz_kNm
legend = Legend(Colour=beamview.LegendColors, Tags=beamview.LegendTags, LegendType=1)  # disabled
item_14 = ListItem(List=b_forces.NormalForce_kN, Index=0, Wrap=True)  # -> flatten(Item)
num_elastic_modulus_kn_cm_2 = RemoteSender(disassemble.YoungsModulusKNCm2Dir12)
num_target_load_demand_kn = RemoteSender(item_14)

# ---- group: Export for test matching
num_design_length_2 = RemoteReceiver(num_design_length)
roundd = RoundToDecimalPlace(NumberX=num_design_length_2, DecimalPlace="3", RoundType=0)  # -> Rounded, Difference
num_inventory_length_5 = RemoteReceiver(num_inventory_length)
cset_4 = CreateSet(List=num_design_length_2)  # -> Set, Map
panel_25 = Panel("3")
panel_26 = Panel(cset_4.Set)
panel_27 = Panel(num_inventory_length_5)
ma_2 = MassAddition(Input=num_inventory_length_5)  # -> Result, PartialResults
ma_3 = MassAddition(Input=num_design_length_2)  # -> Result, PartialResults
panel_28 = Panel(num_design_length_2)
mindex_2 = MemberIndex(Set=num_design_length_2, Member=cset_4.Set)  # -> Index, Count
bnd = Bounds(Numbers=cset_4.Set)
panel_29 = Panel(ma_2.Result)
panel_30 = Panel(ma_3.Result)
lng_7 = ListLength(List=cset_4.Set)
dedomain = DeconstructDomain(Domain=bnd)  # -> Start, End
panel_31 = Panel(mindex_2.Count)
division_5 = Division(A=num_inventory_length_5, B=dedomain.Start)
round_3 = Round(Number=division_5)  # -> Nearest, Floor, Ceiling
max = Maximum()
bnd_2 = Bounds(Numbers=round_3.Ceiling)
dedomain_2 = DeconstructDomain(Domain=bnd_2)  # -> Start, End
python_3 = GhPythonScript(set_size=lng_7, combination_size=dedomain_2.End)  # -> out, a
# ---------- python_3: Python ----------
import rhinoscriptsyntax as rs

from itertools import combinations_with_replacement

ids = list(range(set_size))

combinations = list(combinations_with_replacement(ids,combination_size))
print(combinations)
print(len(combinations))
# ---------- end python_3 ----------
panel_32 = Panel(dedomain_2.End)

# ---- group: Allowable Stress 0.5 of Yield Stress
num_13 = Number(disassemble.YieldStrengthKNCm2Dir12)
multiplication_4 = Multiplication(A=num_13, B="0.5")
allowable_stress_kn_cm_2 = RemoteSender(multiplication_4)

# ----
mesh_4 = Mesh(beamview.MeshesOfRenderedBeams)
unflatten = UnflattenTree(Tree=mesh_4, Guide=col_6)
msh2psrf = MeshToPolysurface(Mesh=unflatten, Triangles=False, FaceMerge=False)
# Matching
preview_4 = CustomPreview(Geometry=msh2psrf, Material=col_6)
num_design_length_3 = RemoteReceiver(num_design_length)
cset_5 = CreateSet(List=num_design_length_3)  # -> Set, Map
int_design_map = RemoteSender(cset_5.Map)
mindex_3 = MemberIndex(Set=num_design_length_3, Member=cset_5.Set)  # -> Index, Count
lng_8 = ListLength(List=cset_5.Set)
multiplication_5 = Multiplication(A=lng_5, B=lng_8)
num_elastic_modulus_kn_cm_2_2 = RemoteReceiver(num_elastic_modulus_kn_cm_2)
hops = Hops(
    Stock=num_inventory_length_2,
    PartLengths=cset_5.Set,
    PartCounts=mindex_3.Count,
    CacheSolveResults=True,
    RemoteDefinitionLocation="http://127.0.0.1:5000/solve",
    RemoteSolveVersion=(0, 1, 0))
num_target_load_demand_kn_2 = RemoteReceiver(num_target_load_demand_kn)
allowable_stress_kn_cm_2_2 = RemoteReceiver(allowable_stress_kn_cm_2)
num_design_length_4 = RemoteReceiver(num_design_length)

# ----
# Julia Matching backend
panel_33 = Panel("\jl_scripts\hungarian_upcycling.jl")
concat_2 = Concatenate(FragmentA=txt_gh_file_path_2, FragmentB=panel_33)
compute_matching = BooleanToggle(True)
reload = Button()
python_4 = GhPythonScript(x=concat_2)  # -> a
# ---------- python_4: Python ----------
import os
a = os.path.abspath(x)
assert os.path.exists(a)
# ---------- end python_4 ----------
python_5 = GhPythonScript(
    compute=compute_matching,
    reload=reload,
    jl_script_path=python_4,
    demand_lengths=num_design_length_4,
    supply_lengths=num_inventory_length_3,
    demand_loads=num_target_load_demand_kn_2,
    supply_cross_sec_xs=num_10,
    supply_cross_sec_ys=num_9,
    allowable_stress=allowable_stress_kn_cm_2_2,
    elastic_modulus=num_elastic_modulus_kn_cm_2_2,
    penalty=num_3)  # -> out, assignment, cost, material_coverage; inputs demand_lengths: list, supply_lengths: list, demand_loads: list, supply_cross_sec_xs: list, supply_cross_sec_ys: list
# ---------- python_5: Python ----------
import Grasshopper.DataTree as DataTree # Add, AddRange(list, GHPath(i, j))
import Grasshopper.Kernel.Data.GH_Path as GHPath
import System
from System.Collections.Generic import List

from ghpythonlib.treehelpers import list_to_tree, tree_to_list

import math
import scriptcontext as sc
import ghpythonremote
from time import time
np = sc.sticky['numpy']
rpy = sc.sticky['rpy']
jl = sc.sticky['julia']

##############################

#st_time = time()
np_demand_lengths = ghpythonremote.deliver(rpy, demand_lengths)
np_supply_lengths = ghpythonremote.deliver(rpy, supply_lengths)
np_demand_loads = ghpythonremote.deliver(rpy, demand_loads)
np_supply_cross_sec_xs = ghpythonremote.deliver(rpy, supply_cross_sec_xs)
np_supply_cross_sec_ys = ghpythonremote.deliver(rpy, supply_cross_sec_ys)
#total_time = time() - st_time
#print('numpy data ghpyremote sending takes {} ms'.format(total_time*1e3))

#st_time = time()
try:
    jl.Main.eval('println("Julia env inititated.")')
except:
    jl.Julia()

try:
    jl.Main.eval('using Main:hungarian_upcycling_assignment')
    if reload:
        raise RuntimeError()
except:
    jl.Main.include(jl_script_path)
#total_time = time() - st_time
#print('Julia setup takes {} ms'.format(total_time*1e3))

if compute:
    st_time = time()

    _assignment, _cost_opt, _material_cov = \
        jl.Main.hungarian_upcycling_assignment(np_demand_lengths, np_supply_lengths, np_demand_loads, 
            np_supply_cross_sec_xs, np_supply_cross_sec_ys, 
            allowable_stress, elastic_modulus, penalty)
    if _assignment is not None:
        assert np.all(_assignment>0), 'Assignment has zero indices (which should all >= 1).'
        print('Cost {}'.format(_cost_opt))
        # Julia is 1-indexed
        _assignment -= 1
        total_time = time() - st_time
        print('Julia computation used {:.1f} mins'.format(total_time/60))
        print('~ {:.1f} secs'.format(total_time))
        if _cost_opt >= penalty:
            #assignment_list = ghpythonremote.obtain(_assignment.tolist())
            #assignment = [int(v) for v in assignment_list]
            assignment = None
            material_coverage = 0.0
        else:
            assignment_list = ghpythonremote.obtain(_assignment.tolist())
            assignment = [int(v) for v in assignment_list]
            material_coverage = float(_material_cov)
        cost = _cost_opt
    else:
        print("Inventory not large enough.")
        assignment = None
        cost = penalty*len(demand_loads)
        material_coverage = 0.0
# ---------- end python_5 ----------
num_14 = Number(python_5.cost)
num_15 = Number(python_5.material_coverage)
int_5 = Integer(python_5.assignment)
panel_34 = Panel(python_5.out)
panel_35 = Panel(num_14)

panel_36 = Panel(num_target_load_demand_kn_2)
split_7 = SplitList(List=hops, Index=multiplication_5)  # -> ListA, ListB
partition = PartitionList(List=split_7.ListA, Size=lng_5)  # -> simplify(Chunks)
int_design_map_2 = RemoteReceiver(int_design_map)
flip = FlipMatrix(Data=partition)
neg_4 = Negative(Value=python_5.cost)
python_6 = GhPythonScript(stock_matrix=flip, design_map=int_design_map_2)  # -> out, matching; inputs stock_matrix: tree of Int32, design_map: list of Int32
# ---------- python_6: Python ----------
import rhinoscriptsyntax as rs

import ghpythonlib.treehelpers as tr
import ghpythonlib.components as gh

stock_matrix = tr.tree_to_list(stock_matrix,0)


stock_counter = [0] * (max(design_map) + 1)

output = []

for i in range(len(design_map)):
    part_id = design_map[i]
    while stock_matrix[stock_counter[part_id]][part_id] == 0:
        stock_counter[part_id] += 1
    stock_matrix[stock_counter[part_id]][part_id] -= 1
    output.append(stock_counter[part_id])

matching = output
# ---------- end python_6 ----------
merge_7 = Merge(Data1=python_5.material_coverage, Data2=neg_4)
moo = MOO(
    Variables=[number_slider, number_slider_3, number_slider_4, number_slider_2, number_slider_5, number_slider_6, number_slider_7, number_slider_8, number_of_domes],
    Objectives=merge_7,
    PopulationSize="10",
    Generations="10",
    Seed="0",
    Filename="moo_out.csv",
    Directory=txt_gh_file_path_4)  # -> ParetoFront, AllSolutions
num_design_length_5 = RemoteReceiver(num_design_length)

# ----
# C# Matching backend
num_design_length_6 = RemoteReceiver(num_design_length)
num_inventory_length_6 = RemoteReceiver(num_inventory_length)
num_target_load_demand_kn_3 = RemoteReceiver(num_target_load_demand_kn)
num_elastic_modulus_kn_cm_2_3 = RemoteReceiver(num_elastic_modulus_kn_cm_2)
allowable_stress_kn_cm_2_3 = RemoteReceiver(allowable_stress_kn_cm_2)
python_7 = GhPythonScript(
    demand_lengths=num_design_length_6,
    supply_lengths=num_inventory_length_6,
    demand_loads=num_target_load_demand_kn_3,
    supply_cross_sec_xs=num_10,
    supply_cross_sec_ys=num_9,
    allowable_stress=allowable_stress_kn_cm_2_3,
    elastic_modulus=num_elastic_modulus_kn_cm_2_3,
    penalty=num_3)  # -> out, cost_matrix; inputs demand_lengths: list, supply_lengths: list, demand_loads: list, supply_cross_sec_xs: list, supply_cross_sec_ys: list; disabled
# ---------- python_7: Python ----------
import Grasshopper.DataTree as DataTree # Add, AddRange(list, GHPath(i, j))
import Grasshopper.Kernel.Data.GH_Path as GHPath
import System
from System.Collections.Generic import List
import math

from ghpythonlib.treehelpers import list_to_tree, tree_to_list
##############################

def compute_moment_of_inertia(b,h):
    # input: b,h in meter
    # return: I in cm^4
    return (b*pow(h,3)/12)*1e8

def compute_strength_capacity(b,h,Fy):
    # input: b,h in meter;
    #        Fy in kN/cm^2: allowable stress
    # return: Fmax in kN
    return b*h*1e4*Fy

def compute_buckling_capacity(b,h,L,E):
    # input: b,h,L in meter, E in kN/cm^2
    # return: buckling capacity R in kN
    I = compute_moment_of_inertia(b,h)
    return (1.0/3)*pow(math.pi,2)*E*I/pow(L,2)*1e-4
    
######################################

demand_num = len(demand_lengths)
supply_num = len(supply_lengths)
assert demand_num <= supply_num, 'demand_num ({}) > supply_num ({})'.format(demand_num, supply_num)
assert len(demand_loads) == demand_num
assert len(supply_cross_sec_xs) == supply_num
assert len(supply_cross_sec_ys) == supply_num

cost_matrix = [[0.0 for _ in range(supply_num)] for _ in range(demand_num)]

for i in range(demand_num):
    for j in range(supply_num):
        Li = demand_lengths[i]
        Lj = supply_lengths[j]
        if Li > Lj:
            # length constraint violated
            cost_matrix[i][j] = penalty
        else:
            demand_load = demand_loads[i]
            b = max(supply_cross_sec_xs[j], supply_cross_sec_ys[j])
            h = min(supply_cross_sec_xs[j], supply_cross_sec_ys[j])
            tensile_capacity = compute_strength_capacity(b,h,allowable_stress)
            capacity = 0.0
            if demand_load >= 0:
                # tensile demand
                capacity = tensile_capacity
            else:
                # compressive demand
                L = min(Li,Lj) # in meter
                buckling_capacity = compute_buckling_capacity(b,h,L,elastic_modulus)
                compressive_capacity = min(buckling_capacity, tensile_capacity)
                capacity = min(tensile_capacity, compressive_capacity)
            if abs(demand_load) > capacity:
                # capacity constraint violated
                cost_matrix[i][j] = penalty
            else:
                # euclidean distance
                cost_matrix[i][j] = math.sqrt(pow(Li-Lj,2)+\
                                    pow(abs(capacity)-abs(demand_load),2))

cost_matrix = list_to_tree(cost_matrix, source=[])
# ---------- end python_7 ----------
num_16 = Number(python_7.cost_matrix)
dam = DataDam(DataA=num_16, BufferDelay=10000000, BufferMode=0)
num_17 = Number(num_3)

# ---- group: using external dll
c_script = CSharpScript(
    distance_matrix=dam,
    integral_scale="1e2",
    penalty=num_17,
    Reference="C:\USERS\MATTJ\DOCUMENTS\ETH\ALGORITHMIC_CIRCULAR_DESIGN\HungarianAlgorithm.dll")  # -> out, matched_A2B_ids, cost_star; inputs distance_matrix: tree of Double, integral_scale: Double, penalty: Double
# ---------- c_script: C# usings ----------
using System.IO;
using System.Linq;
using System.Data;
using System.Drawing;
using System.Reflection;
using System.Windows.Forms;
using System.Xml;
using System.Xml.Linq;
using System.Runtime.InteropServices;

using Rhino.DocObjects;
using Rhino.Collections;
using GH_IO;
using GH_IO.Serialization;

using HungarianAlgorithm;
using HungarianAlgorithm.Extensions;
# ---------- c_script: C# ----------
    // dimension of the input lists
    int n = distance_matrix.BranchCount;
    int m = distance_matrix.Branch(0).Count;

    if(0 == m * n)
    {
      this.Component.AddRuntimeMessage(Grasshopper.Kernel.GH_RuntimeMessageLevel.Error, "intput tree data branch dimension = 0!");
      return;
    }

    if(n > m)
    {
      this.Component.AddRuntimeMessage(Grasshopper.Kernel.GH_RuntimeMessageLevel.Error,
        "Branch count must be smaller than the size of each branch! (design pt number should be smaller than inventory pts!)");
      return;
    }
    // The algorithm doesn't always produce the most optimal result, when the input contains more columns (m) than rows (n).
    // To overcome this issue, square the dimensions of the input before passing it to the algorithm.

    //    var watch = new System.Diagnostics.Stopwatch();
    //    if(timing)
    //    {
    //      watch.Start();
    //    }

    // generate the cost matrix
    int[,] costs = new int[m, m];

    for(int i = 0; i < m; i++)
    {
      for(int j = 0; j < m; j++)
      {
        if(i >= n)
        {
          // fill the matrix to be square
          costs[i, j] = (int) Int32.MaxValue;
        }
        else
        {
          // the algorithm only takes integral inputs, scale it up here.
          double scaled_cost = distance_matrix.Branch(i)[j] * integral_scale;
          if(scaled_cost > Int32.MaxValue) {
            throw new OverflowException(
              //            this.Component.AddRuntimeMessage(Grasshopper.Kernel.GH_RuntimeMessageLevel.Error,
              String.Format("Cost at ({0},{1}): {2} bigger than maximal integral value {3}", i, j, scaled_cost, Int32.MaxValue));
          }
          costs[i, j] = (int) scaled_cost;
//          if (costs[i, j] < 1e-6)
//          {
//            Print(String.Format("{0}",costs[i, j]));
//          }
        }
      }
    }

    int[,] costs_copy = (int[,]) costs.Clone();
    double final_cost = 0;
    
    int[] matched_pts2_ids = HungarianAlgorithm.HungarianAlgorithm.FindAssignments(costs);

    DataTree<int> matched_A2B = new DataTree<int>();
    for(int i = 0; i < n; i++)
    {
      var pth = new GH_Path(i);
      final_cost += (double) costs_copy[i, matched_pts2_ids[i]] / integral_scale;
      matched_A2B.Add(matched_pts2_ids[i], pth);
    }

    if(final_cost > penalty)
    {
      this.Component.AddRuntimeMessage(Grasshopper.Kernel.GH_RuntimeMessageLevel.Error,
        "Computed assignment cost > penalty terms!");
      throw new Exception("Infeasible matching.");
    }

    //    if(timing)
    //    {
    //      watch.Stop();
    //      Print(String.Format("Execution Time: {0} ms", watch.ElapsedMilliseconds));
    //    }

    matched_A2B_ids = matched_A2B;
    cost_star = final_cost;
# ---------- end c_script ----------

# ----
int_6 = Integer(flatten(c_script.matched_A2B_ids))
num_18 = Number(c_script.cost_star)
panel_37 = Panel(num_18)

filter_7 = StreamFilter(Gate=list_2, Stream0=int_6, Stream1=int_5)
filter_8 = StreamFilter(Gate=list_2, Stream0=num_18, Stream1=num_14)

# ---- group: inventory color
# design lines
crv_design_curves_3 = RemoteReceiver(crv_design_curves)
int_design_id_inventory_id = Integer(simplify(graft(filter_7)))
box_inventory_4 = RemoteReceiver(flatten(box_inventory))
S = Shader([{diffuse=RGB(11, 125, 222), emission=RGB(3, 38, 67), shine=0.5, specular=RGB(255, 255, 255), transparency=0}, {diffuse=RGB(222, 37, 11), emission=RGB(67, 11, 3), shine=0.5, specular=RGB(255, 255, 255), transparency=0}, {diffuse=RGB(71, 222, 11), emission=RGB(21, 67, 3), shine=0.5, specular=RGB(255, 255, 255), transparency=0}, {diffuse=RGB(222, 194, 11), emission=RGB(67, 58, 3), shine=0.5, specular=RGB(255, 255, 255), transparency=0}])
panel_38 = Panel(""".5
.1""")
swatch = ColourSwatch(SwatchColor=RGB(12, 203, 142))
swatch_2 = ColourSwatch(SwatchColor=RGB(90, 169, 172))
panel_39 = Panel("""5.0
1.0""")
Z_8 = UnitZ(Factor=Slider(11.8, range=0..20))
xy_2 = XYPlane(Origin=Point(0, 0, 0))
move_13 = Move(Geometry=xy_2, Motion=Z_8)  # -> Geometry, Transform

# ---- group: inventory color / design curves
crv_3 = Curve(flatten(crv_design_curves_3))

# ---- group: inventory color / {inventory} -> design
py_flip_relation = GhPythonScript(int_tree=int_design_id_inventory_id)  # -> out, a; inputs int_tree: tree of Int32
# ---------- py_flip_relation: Python ----------
import Rhino.Geometry.Plane as Plane
import Rhino.Geometry.Point3d as Point3d
import Rhino.Geometry.Vector3d as Vector3d
import Rhino.Geometry.Quaternion as Quat
import Grasshopper.DataTree as DataTree # Add, AddRange(list, GHPath(i, j))
import Grasshopper.Kernel.Data.GH_Path as GHPath
import System
from System.Collections.Generic import List

from ghpythonlib.treehelpers import list_to_tree, tree_to_list
import os
import json
##############################

data_from_branch = tree_to_list(int_tree, lambda x:x)
branch_from_data = DataTree[int]()
for i, data in enumerate(data_from_branch):
    for d in data:
        branch_from_data.Add(i, GHPath(d))
a = branch_from_data
# ---------- end py_flip_relation ----------

# ----
int_inventory_id_design_id = Integer(py_flip_relation.a)

# ----
# Text Output
num_dome_floor_area_2 = RemoteReceiver(num_dome_floor_area)
ma_4 = MassAddition(Input=num_dome_floor_area_2)  # -> Result, PartialResults
num_total_floor_area = Number(flatten(ma_4.Result))
num_matching_score = Number(flatten(filter_8))
crv_design_curves_4 = RemoteReceiver(crv_design_curves)
int_dome_count_4 = RemoteReceiver(int_dome_count)
box_inventory_5 = RemoteReceiver(box_inventory)
format = Format(Format="{0:0.00}", Culture=127, Data0=num_matching_score)
larger = LargerThan(FirstNumber=num_matching_score, SecondNumber=num_3)  # -> LargerThan, OrEqualTo
division_6 = Division(A=num_matching_score, B=num_total_floor_area)
num_19 = Number(num_15)
format_2 = Format(Format="{0:0.00}", Culture=127, Data0=num_total_floor_area)
format_3 = Format(Format="{0:0.00}", Culture=127, Data0=num_19)
format_4 = Format(Format="{0:0.00}", Culture=127, Data0=division_6)
lng_9 = ListLength(List=flatten(box_inventory_5))
lng_10 = ListLength(List=flatten(crv_design_curves_4))
filter_9 = StreamFilter(Gate=larger.OrEqualTo, Stream0=format, Stream1="infeasible")
int_7 = Integer(int_dome_count_4)
num_inventory_label_x_coordinate_3 = RemoteReceiver(num_inventory_label_x_coordinate)
concat_3 = Concatenate(FragmentA="# inventory: ", FragmentB=lng_9)
concat_4 = Concatenate(FragmentA="# of domes: ", FragmentB=int_7)
concat_5 = Concatenate(FragmentA="# design: ", FragmentB=lng_10)
concat_6 = Concatenate(FragmentA="matching score: ", FragmentB=filter_9)
concat_7 = Concatenate(FragmentA="floor area: ", FragmentB=format_2)
concat_8 = Concatenate(FragmentA="material coverage: ", FragmentB=format_3)
concat_9 = Concatenate(FragmentA="objective: ", FragmentB=format_4)
concat_10 = Concatenate(
    FragmentA=concat_3,
    FragmentF=concat_4,
    FragmentB=concat_5,
    FragmentB_2=concat_6,
    FragmentE=concat_7,
    FragmentI=concat_8,
    FragmentK=concat_9)

addition_7 = Addition(A=Slider(4.09, range=0..100), B=num_inventory_label_x_coordinate_3)

pt_8 = ConstructPoint(XCoordinate=addition_7, YCoordinate=Slider(14.98, range=0..100), ZCoordinate=0)
xy_3 = XYPlane(Origin=pt_8)
tag_3 = TextTag3D(Location=xy_3, Text=concat_10, Size=Slider(1.3, range=0.5..5), Colour="0,0,0", Justification=7)

# ---- group: inventory color (continued)
tstat_3 = TreeStatistics(Tree=int_inventory_id_design_id)  # -> Paths, Length, Count
split_8 = SplitTree(Data=simplify(graft(box_inventory_4)), Masks=flatten(tstat_3.Paths))  # -> Positive, Negative
split_9 = SplitTree(Data=graft_3, Masks=flatten(tstat_3.Paths))  # -> Positive, Negative
item_15 = ListItem(List=num_design_length_5, Index=int_inventory_id_design_id, Wrap=True)
num_20 = Number(item_15)
ma_5 = MassAddition(Input=num_20)  # -> Result, PartialResults
subtraction_11 = Subtraction(A=ma_5.PartialResults, B=num_20)
Z_9 = UnitZ(Factor=subtraction_11)
int_8 = Integer(int_inventory_id_design_id)
col_7 = Colour(split_9.Positive)
S_2 = Shader(col_7)
python_8 = GhPythonScript(materials=S_2, design_from_inventory=int_8)  # -> out, mat_from_design; inputs materials: tree, design_from_inventory: tree
# ---------- python_8: Python ----------
import Rhino.Geometry.Plane as Plane
import Rhino.Geometry.Point3d as Point3d
import Rhino.Geometry.Vector3d as Vector3d
import Rhino.Geometry.Quaternion as Quat
import Grasshopper.DataTree as DataTree # Add, AddRange(list, GHPath(i, j))
import Grasshopper.Kernel.Data.GH_Path as GHPath
import System
from System.Collections.Generic import List
import Rhino.Geometry.GeometryBase as GeometryBase
import Rhino.Display.DisplayMaterial as DisplayMaterial
from Grasshopper.Kernel.Types import GH_Material

from ghpythonlib.treehelpers import list_to_tree, tree_to_list
import os
import json
##############################

# total_num_design = design_from_inventory.DataCount
mat_from_design = DataTree[GH_Material]()

for inv_path in materials.Paths:
    num_design = len(materials.Branch(inv_path))
    for d_id, geo in zip(design_from_inventory.Branch(inv_path), materials.Branch(inv_path)):
        mat_from_design.Add(GH_Material(geo), GHPath(d_id))
# ---------- end python_8 ----------
crv_4 = Curve(simplify(graft(crv_3)))
pframe = PerpFrame(Curve=reparameterize(crv_4), Parameter="0.5")
pt_9 = Point(pframe)
shader = Shader(python_8.mat_from_design)
gate = StreamGate(Stream=pt_9, Gate=viz_matching_line)  # -> Target0, Target1

# ----
split_10 = SplitTree(Data=simplify(graft(num_inventory_length_4)), Masks=flatten(tstat_3.Paths))  # -> Positive, Negative
debox_4 = DeconstructBox(Box=split_8.Positive)  # -> Plane, X, Y, Z

# ---- group: inventory color (continued)
division_7 = Division(A=num_20, B=split_10.Positive)
scale_nu = ScaleNU(Geometry=split_8.Positive, Plane=debox_4.Plane, ScaleX=1, ScaleY=1, ScaleZ=division_7)  # -> Geometry, Transform
move_14 = Move(Geometry=scale_nu.Geometry, Motion=Z_9)  # -> Geometry, Transform
geo = Geometry(move_14.Geometry)
clean = CleanTree(RemoveNulls=True, RemoveInvalid=True, RemoveEmpty=False, Tree=geo)
lng_11 = ListLength(List=clean)
python_9 = GhPythonScript(geos=move_14.Geometry, design_from_inventory=int_8)  # -> out, geo_from_design, design_from_cutoff; inputs geos: tree of GeometryBase, design_from_inventory: tree
# ---------- python_9: Python ----------
import Rhino.Geometry.Plane as Plane
import Rhino.Geometry.Point3d as Point3d
import Rhino.Geometry.Vector3d as Vector3d
import Rhino.Geometry.Quaternion as Quat
import Grasshopper.DataTree as DataTree # Add, AddRange(list, GHPath(i, j))
import Grasshopper.Kernel.Data.GH_Path as GHPath
import System
from System.Collections.Generic import List
import Rhino.Geometry.GeometryBase as GeometryBase

from ghpythonlib.treehelpers import list_to_tree, tree_to_list
import os
import json
##############################

# total_num_design = design_from_inventory.DataCount
geo_from_design = DataTree[GeometryBase]()
design_from_cutoff = DataTree[bool]()

for inv_path in geos.Paths:
    num_design = len(geos.Branch(inv_path))
    for d_id, geo in zip(design_from_inventory.Branch(inv_path), geos.Branch(inv_path)):
        geo_from_design.Add(geo, GHPath(d_id))
        design_from_cutoff.Add(num_design>1, GHPath(d_id))
# ---------- end python_9 ----------
repeat = RepeatData(Data=S, Length=lng_11)  # -> simplify(Data)
geo_2 = Geometry(python_9.geo_from_design)
volume_5 = Volume(Geometry=geo_2)  # -> Volume, Centroid
xy_4 = XYPlane(Origin=volume_5.Centroid)
orient_2 = Orient(Geometry=geo_2, Source=xy_4, Target=pframe)  # -> Geometry, Transform
bool = Boolean(python_9.design_from_cutoff)
gate_2 = StreamGate(Stream=volume_5.Centroid, Gate=viz_matching_line)  # -> Target0, Target1
ln_4 = Line(StartPoint=gate.Target1, EndPoint=volume_5.Centroid)
project_3 = Project(Geometry=gate_2.Target0, Plane=move_13.Geometry)  # -> Geometry, Transform
dots_3 = DotDisplay(Point=flatten(project_3.Geometry), Colour=swatch, Size=Slider(0.3, range=0..1))

# ---- group: inventory color / Visualize Just Matched Elements
preview_5 = CustomPreview(Geometry=clean, Material=col_7)

# ---- group: inventory color / viz matching lines
dispatch_3 = Dispatch(List=flatten(ln_4), DispatchPattern=flatten(bool))  # -> ListA, ListB
dash = DashPattern(Curve=dispatch_3.ListA, Pattern=panel_38)  # -> simplify(Dashes), Gaps
dash_2 = DashPattern(Curve=dispatch_3.ListB, Pattern=panel_38)  # -> simplify(Dashes), Gaps
preview_6 = CustomPreview(Geometry=dash.Dashes, Material=swatch_2)
preview_7 = CustomPreview(Geometry=dash_2.Dashes, Material=swatch)
preview_8 = CustomPreview(Geometry=orient_2.Geometry, Material=shader)

# ----
number_slider_13 = Slider(80, range=0..164)  # disabled
tstat_4 = TreeStatistics(Tree=orient_2.Geometry)  # -> Paths, Length, Count; disabled
item_16 = ListItem(List=flatten(bool), Index=number_slider_13, Wrap=True)  # disabled
item_17 = ListItem(List=tstat_4.Paths, Index=number_slider_13, Wrap=True)  # disabled
item_18 = ListItem(List=flatten(ln_4), Index=number_slider_13, Wrap=True)  # disabled
branch_3 = TreeBranch(Tree=orient_2.Geometry, Path=item_17, MaintainPaths=True)  # disabled
dash_3 = DashPattern(Curve=item_18, Pattern=panel_38)  # -> simplify(Dashes), Gaps; disabled
branch_4 = TreeBranch(Tree=shader, Path=item_17, MaintainPaths=True)  # disabled
filter_10 = StreamFilter(Gate=item_16, Stream0=swatch, Stream1=swatch_2)  # disabled
preview_9 = CustomPreview(Geometry=dash_3.Dashes, Material=filter_10)  # disabled
preview_10 = CustomPreview(Geometry=branch_3, Material=branch_4)  # disabled

mpipe = MeshPipe(Polylines=dispatch_3.ListB, NumberOfSides=4, Tolerance=0.1, Radius="0.01", Cap=False, Join=False)
preview_11 = CustomPreview(Geometry=mpipe, Material=rgb)

# ==== cluster Cluster
domain = ClusterInput()
deconstruct_domain = DeconstructDomain(Domain=domain)  # -> Start, End
subtraction = Subtraction(A=deconstruct_domain.End, B=deconstruct_domain.Start)
result = ClusterOutput(subtraction)

# ==== cluster Cluster_2
list = ClusterInput()
size = ClusterInput()
partition_list = PartitionList(List=list, Size=size)
list_item = ListItem(List=partition_list, Index=0, Wrap=True)
shift_paths = ShiftPaths(Data=list_item, Offset=-1)
data = ClusterOutput(shift_paths)

# ==== cluster Cluster_3
number = ClusterInput()
number_2 = Number(number)
sort_list = SortList(Keys=flatten(number_2))  # -> Keys, ValuesValuesA
list_item = ListItem(List=sort_list.Keys, Index=0, Wrap=True)  # -> Item1, Item
domain_end = ClusterInput()
construct_domain = ConstructDomain(DomainStart=list_item.Item, DomainEnd=list_item.Item1)
construct_domain_2 = ConstructDomain(DomainStart="0", DomainEnd=domain_end)
remap_numbers = RemapNumbers(Value=number_2, Source=construct_domain, Target=construct_domain_2)  # -> Mapped, Clipped
mapped = ClusterOutput(remap_numbers.Mapped)
